# Grasshopper definition 11_Ro_Wall_Off Axis.gh (Grasshopper 1.0.8)
# plug-ins: Pufferfish, Rhino.Inside for Autodesk Revit, Wombat

doubleclick = BooleanToggle(False)
dss_annotation_panel = Panel("Help on WhiteWork")
# Segment
# group modules into larger coherent parts
# User Interface: I/O
dss_log_v5_2 = PythonScript(Help=doubleclick)  # inputs Help: Boolean
# ---------- dss_log_v5_2: Python ----------
"""
Set grasshopper template and provide easy acces to Help file in intranet

"""

"""
Credits:
    20211117
    Created by Vladimir Ondejcik
    White arkitekter AB

Based on:
    WOMBAT version <0.0.1>
    Script by <Brian Ringley>
        def libraries() by <Giulio Piacentino> see <http://www.grasshopper3d.com/forum/topics/gh-filename-is-python>
        def writeToFile() by <Data Analytics Society> see <https://www.youtube.com/watch?v=-TF3mXhnCDw>
    Script version <15 September 2015> 
    Copyright <Creative Commons Sharealike>
"""


#add dsearch default path located on cad.local
import sys
new_path = r"\\sesthfs02\DSEARCH\REPOSITORY\Grasshopper\Xtras\DsearchCode"
if new_path not in sys.path: sys.path.append(new_path)

#import dsearch plugin
import dsearch as ds

import os

print sys.path

#reload module (this has use when working on module)
#reload(ds.DS_Log)
#reload(ds.DS_Links)

#setup template
template=ds.DS_Links.Template
ds.DS_Log.DS_Template(template)

#run help from module 
if Help:
    helpLink=ds.DS_Links.HelpLink
    ds.DS_Log.DS_Help(helpLink)

    #turn toggle back to false
    obj=ghenv.Component.Params.Input[0].Sources[0]
    obj.Value=False
    obj.ExpireSolution(True)
# ---------- end dss_log_v5_2 ----------

dss_projectnumber = Panel("0000")
dss_projectname = Panel("name")

# ----
# Organization of Grasshopper scripts at White:
# Script should be created and annotated always with notion that other person will need to use/edit them.
# Build your script in modules and segments, use color coding and annotation according this template.
# This standard should be applied to all scripts, big or small.
# 
# Read  guide on white work:
# "https://work.white.se/grasshopper-developer-guide/"
# For Advanced users:
# For design scripts running more than a month use "dsInitialize" and "dsScriptLog" functions on Dsearch tab to log changes over time.
dss_annotation_panel_2 = Panel("""Tip of a day:
You can change default colour grups by right clicking
Graphical templates are located on "Dsearch" tab""")
# GRAPHIC
# STANDARD
# In
# data and geometry import from rhino or external platforms
image = ImageSampler(dss_annotation_panel_2, Filter="Colour", Interpolate=False, Umax=1, Umin=0, Vmax=1, Vmin=0, Wrap=0)

query_categories = QueryCategories(Type=1, Name="Walls", IsVisibleUI=True, IsSubcategory=False)
query_grids = QueryGrids()
category_filter = CategoryFilter(Categories=query_categories, Inverted=False)
active_selection = GraphicalElement()
filter_elements = FilterElements(Elements=active_selection, Filter=category_filter)
cull_pattern = CullPattern(List=active_selection, CullPattern=filter_elements)
vector = Vector(unitize(cull_pattern))
line = Line(cull_pattern)
length = Length(Curve=line)

# ----
# Control
# General
# Monitor
# Out
# variable parameters and script execution
# (sliders, boolean togggle, text input,...)
# monitor data and geometry preview (used for panels for example)
# output data to rhino or external platforms
# WIP
# Annotation
# Plugin
# general annotation and notes
# textbased scripting and special plugins
# f.ex: HumanUI, kangaroo,...
# problematic or under repair or construction
dss_annotation_panel_3 = Panel("general development modules")

line_2 = Line(query_grids)
vector_2 = Vector(line_2)
# Rotates curve according to closest near pararell gridline
dot_product = DotProduct(VectorA=unitize(simplify(graft(vector))), VectorB=unitize(vector_2), Unitize=False)
# Back-end
absolute = Absolute(Value=dot_product)
radians = Radians(Degrees=Slider(1, range=0..10))
round_to_decimal_place = RoundToDecimalPlace(NumberX=absolute, DecimalPlace="5", RoundType=0)  # -> Rounded, Difference
cosine = Cosine(Value=radians)
round_to_decimal_place_2 = RoundToDecimalPlace(NumberX=cosine, DecimalPlace="5", RoundType=0)  # -> Rounded, Difference
smaller_than = SmallerThan(FirstNumber=round_to_decimal_place.Rounded, SecondNumber=round_to_decimal_place_2.Rounded)  # -> SmallerThan, OrEqualTo
midpoint = Midpoint(Curve=line)
cull_pattern_2 = CullPattern(List=line_2, CullPattern=invert(smaller_than.SmallerThan))
curve_closest_point = CurveClosestPoint(Point=simplify(graft(midpoint)), Curve=cull_pattern_2)  # -> Point, Parameter, Distance
sort_list = SortList(Keys=curve_closest_point.Distance, ValuesValuesA=cull_pattern_2)  # -> Keys, simplify(ValuesValuesA)
list_item = ListItem(List=sort_list.ValuesValuesA, Index=0, Wrap=True)  # -> simplify(Item)
vector_3 = Vector(list_item)

number_slider = Slider(1, range=0..1)
deconstruct = Deconstruct(Point=midpoint)  # -> XComponent, YComponent, ZComponent
vector_4 = Vector(unitize(vector_3))
round_to_decimal_place_3 = RoundToDecimalPlace(NumberX=deconstruct.YComponent, DecimalPlace=number_slider, RoundType=0)  # -> Rounded, Difference
round_to_decimal_place_4 = RoundToDecimalPlace(NumberX=deconstruct.XComponent, DecimalPlace=number_slider, RoundType=0)  # -> Rounded, Difference
division = Division(A=length, B=Slider(2, range=0..10))
construct_point = ConstructPoint(
    XCoordinate=round_to_decimal_place_4.Rounded,
    YCoordinate=round_to_decimal_place_3.Rounded,
    ZCoordinate=deconstruct.ZComponent)
line_sdl = LineSDL(Start=simplify(graft(construct_point)), Direction=vector_4, Length=simplify(graft(length)))
multiplication = Multiplication(A=vector_4, B=simplify(graft(division)))
negative = Negative(Value=multiplication)
move = Move(Geometry=line_sdl, Motion=negative)  # -> Geometry, Transform
flip_curve = FlipCurve(Curve=move.Geometry, Guide=simplify(graft(line)))  # -> Curve, Flag
list_length = ListLength(List=flatten(flip_curve.Curve))
boolean = Boolean(list_length)
stream_filter = StreamFilter(Gate=boolean, Stream1=flip_curve.Curve)

host_inserts = HostInserts(Host=cull_pattern)  # -> Inserts, Shared, Shadows, Openings, Walls
active_view = ActiveView()
element_location = ElementLocation(Element=simplify(host_inserts.Inserts))  # -> Element, Location, Hand, Facing, WorkPlane
radians_2 = Radians(Degrees=Slider(2, range=0..10))
curve_middle = CurveMiddle(Curve=stream_filter)
plane = Plane(active_view)
line_3 = Line(flip_curve.Curve)
point = Point(element_location.Location)
rotate = Rotate(Geometry=curve_middle, Angle=radians_2, Plane=plane)  # -> Geometry, Transform
element_curve = ElementCurve(Element=simplify(graft(cull_pattern)), Curve=rotate.Geometry, FailureProcessingMode=2)  # -> Element, Curve
curve_closest_point_2 = CurveClosestPoint(Point=point, Curve=reparameterize(simplify(graft(line_3))))  # -> simplify(Point), Parameter, Distance
element_curve_2 = ElementCurve(Element=element_curve.Element, Curve=stream_filter, FailureProcessingMode=2)  # -> Element, Curve
list_length_2 = ListLength(List=flatten(element_curve_2.Element))
project = Project(Geometry=curve_closest_point_2.Point, Plane=element_location.Location)  # -> Geometry, Transform
boolean_2 = Boolean(list_length_2)
stream_filter_2 = StreamFilter(Gate=boolean_2, Stream1=project.Geometry)
element_location_2 = ElementLocation(Element=simplify(host_inserts.Inserts), Location=stream_filter_2, FailureProcessingMode=2)  # -> Element, Location, Hand, Facing, WorkPlane
